# Grasshopper definition Ettv_BcaValidationCaseStudy.gh (Grasshopper 1.0.8)
# plug-ins: FacadeFlux Info

fluxmaterial = FluxMaterial()
panel = Panel()
panel_2 = Panel()
merge = Merge(Data1=fluxmaterial)
fluxfenestrationconstruction = FluxFenestrationConstruction()
brep = Brep([<brep referenced from the Rhino model> x2])
brep_2 = Brep([<brep referenced from the Rhino model> x2])
brep_3 = Brep([<brep referenced from the Rhino model> x2])
brep_4 = Brep([<brep referenced from the Rhino model> x2])
brep_5 = Brep([<brep referenced from the Rhino model> x2])
brep_6 = Brep([<brep referenced from the Rhino model> x21])
brep_7 = Brep([<brep referenced from the Rhino model> x21])
brep_8 = Brep([<brep referenced from the Rhino model> x21])
fluxfenestrationconstruction_2 = FluxFenestrationConstruction(Id=panel, Name=panel_2, Materials=merge)
deconstruct_brep = DeconstructBrep(Brep=brep)  # -> flatten(Faces), Edges, Vertices
deconstruct_brep_2 = DeconstructBrep(Brep=brep_2)  # -> flatten(Faces), Edges, Vertices
deconstruct_brep_3 = DeconstructBrep(Brep=brep_3)  # -> flatten(Faces), Edges, Vertices
deconstruct_brep_4 = DeconstructBrep(Brep=brep_4)  # -> flatten(Faces), Edges, Vertices
deconstruct_brep_5 = DeconstructBrep(Brep=brep_5)  # -> flatten(Faces), Edges, Vertices
deconstruct_brep_6 = DeconstructBrep(Brep=brep_6)  # -> flatten(Faces), Edges, Vertices
deconstruct_brep_7 = DeconstructBrep(Brep=brep_7)  # -> flatten(Faces), Edges, Vertices
deconstruct_brep_8 = DeconstructBrep(Brep=brep_8)  # -> flatten(Faces), Edges, Vertices
fluxsurface = FluxSurface(Geometry=deconstruct_brep_7.Faces)
fluxsurface_2 = FluxSurface(Geometry=deconstruct_brep_8.Faces)
fluxsurface_3 = FluxSurface(Geometry=deconstruct_brep_6.Faces)
fluxsurface_4 = FluxSurface(Geometry=deconstruct_brep_5.Faces)
fluxsurface_5 = FluxSurface(Geometry=deconstruct_brep_2.Faces)
fluxsurface_6 = FluxSurface(Geometry=deconstruct_brep_4.Faces)
fluxsurface_7 = FluxSurface(Geometry=deconstruct_brep_3.Faces)
fluxsurface_8 = FluxSurface(Geometry=deconstruct_brep.Faces)
merge_2 = Merge(
    Data1=fluxsurface_8,
    Data2=fluxsurface_5,
    Data3=fluxsurface_6,
    Data4=fluxsurface_7,
    Data5=fluxsurface_4,
    Data6=fluxsurface_2,
    Data7=fluxsurface_3,
    Data8=fluxsurface)
fluxmodel = FluxModel(ProjectName="BCA_CaseStudy1", FluxSurfaces=merge_2, AngleToNorth="0")  # -> Status, FluxModel
